vi "index.gviweb"   [LabVIEW NXG 5.0.0]
panel controls:
  "Timezone": string
panel indicators:
  "Connected?": bool
  "RX Data": string
  "WebSockets URL": string
uses:
  WebApp::GetHostname.jsli::GetHostname
  NI::WebSockets::Close WebSocket.gvi
  NI::G Core::Error::Clear Error Cluster.gvi
  NI::WebSockets::Open WebSocket.gvi
  NI::WebSockets::Read String.gvi
  NI::WebSockets::Write String.gvi
diagram:
  disable {
    frame Disabled {
      # Use to test running locally.
      w2 = "ws://192.168.1.116:6123"
    }
    frame Enabled {
      call "GetHostname"() -> (return=w3, error out=w4)
      Format Into String(formatString="ws://%s:6123", errIn=w4, w3) -> (outString=w2, errOut=w1)
    }
  }
  # Place setup code before the loop. For example, perform initial data communication and wire the results into the loop.
  $"WebSockets URL" <- w2
  # Change this according to whether it's being hosted on the Pi (e.g. localhost) or you are accessing remotely (Pi IP address)
  # Top-Level WebVIs usually contain a While Loop that never stops so that they can continue running as long as the web page is open in the user's web browser.
  s1 = "Initialise"  # shift register
  s2 = uninitialised  # shift register
  s3 = $Timezone  # shift register
  while {
    case (s1) {
      frame "Initialise", Default {
        w5 = "Connecting"
        w6 = w1
        w7 = s2
        w8 = s3
      }
      frame "Connecting" {
        Wait(time to wait=250)
        call "Close WebSocket.gvi"(websocket session in=s2, error in=w1) -> (error out=w9)
        call "Clear Error Cluster.gvi"(error in=w9) -> (error out=w10)
        call "Open WebSocket.gvi"(url=w2, error in=w10) -> (websocket session out=w7, error out=w6)
        Select(s=w6, t="Connecting", f="Read") -> w5
        Not(x=w6) -> w11
        $"Connected?" <- w11
        w8 = s3
      }
      frame "Read" {
        call "Read String.gvi"(websocket session in=s2, timeout=5, error in=w1) -> (websocket session out=w7, string response=w12, error out=w6)
        Is Equal(x=s3, y=$Timezone) -> w13
        Select(s=w13, t="Read", f="Set Timezone") -> w14
        Select(s=w6, t="Connecting", f=w14) -> w5
        $"RX Data" <- w12
        w8 = s3
      }
      frame "Set Timezone" {
        Property Node(instance in=reference to "Timezone", error in=w1) -> ("Value"=w15, error out=w16)
        w17 = cluster{"Command": string, "Timezone": string} {all zero or empty}
        Property Node(instance in=w17, "Command"="Timezone", "Timezone"=w15) -> (instance out=w18)
        Flatten To Json(anything=w18, error in (no error)=w16) -> (JSON string=w19, error out=w20)
        call "Write String.gvi"(websocket session in=s2, string message=w19, error in=w20) -> (websocket session out=w7, error out=w6)
        Select(s=w6, t="Connecting", f="Read") -> w5
        Select(s=w6, t=s3, f=$Timezone) -> w8
      }
    }
    next s1 = w5
    next s2 = w7
    next s3 = w8
    stop if FALSE
  }
